# Grasshopper definition Psychrometrics-Legacy.ghx (Grasshopper 1.0.8)
# plug-ins: SAM

sampsychrometrics_psychrometrics = SAMPsychrometricsPsychrometrics(_dryBulbTemperature=20, _relativeHumidity_=50, _pressure_=[101325, 101325], SAM_ComponentVersion="1.0.5")  # -> DryBulbTemperature, RelativeHumidity, HumidityRatio, SaturationHumidityRatio, WetBulbTemperature, DewPointTemperature, SaturationVapourPressure, PartialVapourPressure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
enthalpy = Number(sampsychrometrics_psychrometrics.Enthalpy)
sampsychrometrics_dewpointtemperature = SAMPsychrometricsDewPointTemperature(_dryBulbTemperature=20, _relativeHumidity=50, _pressure_=101325, SAM_ComponentVersion="1.0.1")
dewpointtemperature = Number(sampsychrometrics_dewpointtemperature)
